# Grasshopper definition Aeolus+Exporter.gh (Grasshopper 0.9.76)
# plug-ins: Python Interpreter

refl_srf = Surface([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])
tgt_pts = Point([Point(0.9882541784, 1.272896501, 0.4259615025), Point(-0.9882541784, 1.272896501, 0.4259615025), Point(0, 2.984602948, 0.4259615025)])
src_pts = Point([Point(0.9882541784, -2.61816344, 1.154166821), Point(-0.9882541784, -2.61816344, 1.154166821)])
refl_srf_2 = Surface(refl_srf)
tgt_pts_2 = Point(tgt_pts)
src_pts_2 = Point(src_pts)
panel = Panel("""1
2""")
debrep = DeconstructBrep(Brep=refl_srf_2)  # -> Faces, Edges, Vertices
sources = Point([Point(-4.126553851, 1, 0.4662418592), Point(-3.576906622, 0.5530598521, 0.3353750972)])  # disabled
join = JoinCurves(Curves=debrep.Edges, Preserve=False)  # -> flatten(Curves)
direct_sound = PythonScript(SrcPts=sources)  # -> a, DS; inputs SrcPts: list, TgtPts: list, ReflectSrf: list; disabled
# ---------- direct_sound: Python ----------
import rhinoscriptsyntax as rs
import math

class DirectSound:
    
    ########################## CLASS ATTRIBUTES ##########################
    def __init__(self,SrcPts,TgtPts,ReflectSrf):
        self.SrcPts = SrcPts
        self.TgtPts = TgtPts
        self.ReflectSrf = ReflectSrf
    
    ########################## CLASS METHODS ##########################
    
    #Defining rays of Direct Sound as curve
    def Rays(self):
        
        frays = []    #defining all rays
        for i in range(len(self.SrcPts)):
            subA1 = []
            for j in range(len(self.TgtPts)):
                subA1.append(rs.AddLine(self.SrcPts[i], self.TgtPts[j]))
            frays.append(subA1)
        
        int = []    #checking intersections because of obstacles
        for i in range(len(self.SrcPts)):
            subB1 = []
            for j in range(len(self.TgtPts)):
                subB2 = []
                for h in range(len(self.ReflectSrf)):
                    if (rs.CurveBrepIntersect(frays[i][j],self.ReflectSrf[h])) != None:
                        subB2.append(True)
                    else:
                        subB2.append(False)
                subB1.append(subB2)
            int.append(subB1)
        
        rays = []    #culling wall-stopped rays
        for i in range(len(self.SrcPts)):
            subC1 = []
            for j in range(len(self.TgtPts)):
                subC2 = []
                if any(int[i][j]):
                    subC2.append(None)
                else:
                    subC2.append(frays[i][j])
                subC1.append(subC2)
            rays.append(subC1)
        
        SPL = []    #measuring SPL 
        time = []   #measuring time of flight
        for i in range(len(self.SrcPts)):
            subD1 = []
            subE1 = []
            for j in range(len(self.TgtPts)):
                subD2 = []
                subE2 = []
                if rays[i][j][0] != None:
                    subD2.append(111-(20*(math.log10(rs.CurveLength(rays[i][j][0])-1)))-11)
                    subE2.append((rs.CurveLength(rays[i][j][0]))/343)
                else:
                    subD2.append(None)
                    subE2.append(None)
                subD1.append(subD2)
                subE1.append(subE2)
            SPL.append(subD1)
            time.append(subE1)
        return(rays,SPL,time)

DirectSound = DirectSound(SrcPts,TgtPts,ReflectSrf)
DS = DirectSound.Rays()[1]  # the class return a tuple of datas (rays,SPL,time) that will be computed in the in the ETC solver
a = DirectSound.Rays()[0]
# ---------- end direct_sound ----------
compute = BooleanToggle(True)
parallel = BooleanToggle(False)
image_source = PythonScript(
    parallel=parallel,
    Compute=compute,
    SrcPts=src_pts,
    ReflectSrf=refl_srf,
    r=Slider(1, range=0..1),
    TgtPts=tgt_pts,
    n=panel)  # -> SrcPtsGraft, b; inputs SrcPts: list, ReflectSrf: list, TgtPts: list, n: list of Int32
# ---------- image_source: Python ----------
import rhinoscriptsyntax as rs
import Rhino.Geometry as Rh
import math 
import ghpythonlib.parallel as parallel
#################################################################################
######################### DEFINING TRASFORMATION MATRIX #########################
#################################################################################

DirectionMove_L = []
SrfCenter_L = []
for i in ReflectSrf:
    SurfaceCenterPoint = rs.SurfaceAreaCentroid(i)[0]
    SrfCenter_L.append(SurfaceCenterPoint)
    SurfaceUV = rs.SurfaceClosestPoint(i,SurfaceCenterPoint)
    DirectionMove_L.append(rs.SurfaceNormal(i,SurfaceUV))

MirrorMatrix_L = []
for srfIN in range(len(ReflectSrf)):
    MirrorMatrix_L.append(rs.XformMirror(SrfCenter_L[srfIN] , DirectionMove_L[srfIN]))


#################################################################################
############## DEFINING MIRRORED SORCE POINTS UNTIL INFINITE ORDER ##############
#################################################################################

def graftlist(List):
    MainList = []
    Void = []
    MainList.append(Void)
    
    GraftList = []
    for i in range (len(MainList)):
        for j in List:
            Sub = []
            Sub.append(j)
            GraftList.append(Sub)
    return (GraftList)
SrcPtsGraft = graftlist(SrcPts)

ObjList = []
ObjList.append(SrcPtsGraft)

def RecursiveMirror(SrcPtsGraft,gens):
    Macro = []
    for i in range (len(SrcPts)):
        List = []
        for j in range (len(SrcPtsGraft[0])):
            
            for k in range(len(ReflectSrf)):
                List.append(rs.TransformObjects(SrcPtsGraft[i][j],MirrorMatrix_L[k],True)[0])
        Macro.append(List)
    if gens != 0:
        ObjList.append(Macro)
    if gens > 0:
        RecursiveMirror(Macro,gens-1)
    return(ObjList)

Nmax = max(n)
mSrcN_full = RecursiveMirror(SrcPtsGraft, Nmax )

# REMOVE FROM MIRRORED SOURCE POINTS LIST ALL DUPLICATES

def PointsConversion(coordinate):
    Converted = []
    for i in range (len(mSrcN_full)):
        Csub1 = []
        for j in range (len(SrcPts)):
            Csub2 =[]
            for k in range (len(mSrcN_full[i][j])):
                Csub2.append(round(rs.PointCoordinates(mSrcN_full[i][j][k])[coordinate],2))
            Csub1.append(Csub2)
        Converted.append(Csub1)
    return(Converted)

mSrcN_x = PointsConversion(0)
mSrcN_y = PointsConversion(1)
mSrcN_z = PointsConversion(2)



def RecursiveCull(mSrcN_full,gens,empty):
    if Nmax >= 2:
        mSrcN = []
        for j in range (len(SrcPts)):
            SubM1 = []
            for k in range (len(mSrcN_full[gens][0])):
                if gens >= 2:
                    if (    (round((rs.PointCoordinates(mSrcN_full[gens][j][k])[0]),2)  in (mSrcN_x[(gens-2)][j])) and \
                            (round((rs.PointCoordinates(mSrcN_full[gens][j][k])[1]),2)  in (mSrcN_y[(gens-2)][j])) and \
                            (round((rs.PointCoordinates(mSrcN_full[gens][j][k])[2]),2)  in (mSrcN_z[(gens-2)][j]))):
                        SubM1.append(None)
                        
                    else:
                        SubM1.append(mSrcN_full[gens][j][k])
            mSrcN.append(SubM1)
        empty.insert(0,mSrcN) #Ordine n
        if gens > 2:
            RecursiveCull(mSrcN_full,gens-1,empty)
        return(empty)
    elif Nmax == 1:
        empty.append(mSrcN_full[0])
        empty.append(mSrcN_full[1])
        return(empty)
    else:
        empty.append(mSrcN_full[0])
        return(empty)



empty = []
mSrcN = (RecursiveCull(mSrcN_full,Nmax,empty))
if Nmax >=2:
    mSrcN.insert(0,mSrcN_full[1])
    mSrcN.insert(0,mSrcN_full[0])








#################################################################################
######################## FINDING INTERSECTION PTS AT ORDER N ####################
#################################################################################
def CodeExecution (n):
    #1 FAKE RAYS ORDER N
    fRays = []
    for i in range(len(TgtPts)):
        fRay_Sub = []
        for j in range(len(SrcPts)):
            fRay_Sub2 = []
            for k in range(len(mSrcN[n][0])):
                if mSrcN[n][j][k] != None:
                    fRay_Sub2.append(rs.AddLine(mSrcN[n][j][k],TgtPts[i]))
                else:
                    fRay_Sub2.append(None)
            fRay_Sub.append(fRay_Sub2)
        fRays.append(fRay_Sub)
    
    
    #2 INTERSECTION ORDER N 
    ReflectSrf_t = []
    for i in range (int(len(ReflectSrf)**(n)/len(ReflectSrf))): 
        for Srf in ReflectSrf:
            ReflectSrf_t.append(Srf) #per n = 3 appende 36 volte la lista di 6 per ramo di src
    
    
    Intersection = []
    for i in range (len(TgtPts)):
        sub1 = []
        for j in range (len(SrcPts)):
            sub2 = []
            for w in range(len(ReflectSrf_t)):
                if fRays[i][j][w] != None:
                    Int = rs.CurveBrepIntersect(fRays[i][j][w],ReflectSrf_t[w])
                else:
                    Int = None
                
                
                
                if Int is not None:
                    sub2.append(Int[1][0])
                else:
                    sub2.append(None)
            sub1.append(sub2)
        Intersection.append(sub1)
    
    
    #################################################################################
    #################### FINDING INTERSECTION PTS FROM ORDER N-1 ####################
    #################################################################################
    
    
    #RECURSION ( A N-1 OGNI 6 INTERSEZIONI CORRISPONDE UN IMMAGINE, A N-2 OGNI 36 INT CORRISPONDE UN IMMAGINE)
    
    def RecursiveIntersection (IntPts, gens, IntList):
        
        if n != 1 : 
            fRayN = []
            for i in range (len(TgtPts)):
                sub1 = []
                for j in range (len(SrcPts)):
                    sub2 = []
                    for k in range (len(mSrcN[gens-1][0])):
                        h = k * int((len(Intersection[0][0]))/(len(mSrcN[gens-1][0])))
                        for x in range (int((len(Intersection[0][0]))/(len(mSrcN[gens-1][0])))):
                            if (IntPts [i][j][x + h]) and (mSrcN[gens-1][j][k]) != None:
                                sub2.append(rs.AddLine(IntPts[i][j][x + h],mSrcN[gens-1][j][k]))
                            else:
                                sub2.append(None)
                    sub1.append(sub2)
                fRayN.append(sub1)
            
            ReflectSrf_p = []
            for i in range (((int((len(mSrcN[gens-1][0]))/(len(ReflectSrf)))))):
                for Srf in ReflectSrf:
                    for j in range (int((len(IntPts[0][0]))/(len(mSrcN[gens-1][0])))):
                        ReflectSrf_p.append(Srf)
            
            Pt = []
            for i in range (len(TgtPts)):
                sub1 = []
                for j in range (len(SrcPts)):
                    sub2 = []
                    for k in range(len(ReflectSrf_p)):
                        if fRayN[i][j][k] is not None:
                            Int = rs.CurveBrepIntersect(fRayN[i][j][k],ReflectSrf_p[k])
                        else: 
                            Int = None
                        
                        
                        if Int is not None:
                            sub2.append(Int[1][0])
                        else:
                            sub2.append(None)
                    sub1.append(sub2)
                Pt.append(sub1)
            IntList.append(Pt)
        
        if gens == n:
            IntList.insert(0,Intersection)
        if gens > 2:
            RecursiveIntersection (Pt, gens-1, IntList)
            #aggiunge tre punti: il primo è la funzione, il secondo è intersection, il terzo è frutto della ricorsione
        return(IntList)
    
    IntList = []
    RecInt = RecursiveIntersection(Intersection, n, IntList)
    
    
    #################################################################################
    ################################ DRAW POLYRAYS ##################################
    #################################################################################
    
    
    RList = []
    for i in range (len(TgtPts)):
        Rsub1 = []
        for j in range (len(SrcPts)):
            Rsub2 = []
            for k in range (len(ReflectSrf)**n):
                Rsub3 = []
                for w in range (len(RecInt)):
                    Rsub3.append(RecInt[w][i][j][k])
                Rsub2.append(Rsub3)
            Rsub1.append(Rsub2)
        RList.append(Rsub1)
    
    
    
    for i in range (len(TgtPts)):
        for j in range (len(SrcPts)):
            for k in range (len(RList[0][0])):
                    RList[i][j][k].insert(0,TgtPts[i])
                    RList[i][j][k].append(SrcPts[j])
    polylines = []
    for i in range (len(TgtPts)):
        Plsub1 = []
        for j in range (len(SrcPts)):
            Plsub2 = []
            for k in range (len(RList[0][0])):
                if (None in RList[i][j][k]) == True :
                    Plsub2.append(None)
                else:
                    Plsub2.append(rs.AddPolyline(RList[i][j][k]))
            Plsub1.append(Plsub2)
        polylines.append(Plsub1)
    
    
    #########################################cull polylines list for obstacles
    
    #1 FIND SEGMENTS
    SegmentsList = []
    for i in range (len(TgtPts)):
        SLsub1 = []
        for j in range (len(SrcPts)):
            SLsub2 = []
            for k in range (len(polylines[0][0])):
                if polylines[i][j][k] != None:
                    SLsub2.append(rs.ExplodeCurves(polylines[i][j][k]))            
                else:
                    SLsub2.append(None)
            SLsub1.append(SLsub2)
        SegmentsList.append(SLsub1)
    
    
    #2 FIND INTERSECTION COUNT LIST
    
    SegmentIntlist = []
    for i in range (len(TgtPts)):
        SILsub1 = []
        for j in range (len(SrcPts)):
            SILsub2 = []
            for k in range (len(polylines[0][0])):
                SILsub3 = []
                for w in range (n+1):
                    for x in range (len(ReflectSrf)):
                        if SegmentsList[i][j][k] is not None:
                            Int = rs.CurveBrepIntersect(SegmentsList[i][j][k][w],ReflectSrf[x])
                        else:
                            Int = None
                        
                        if Int is not None:
                            SILsub3.append(Int[1][0])
                        else:
                            SILsub3.append(None)
                SILsub2.append(len(SILsub3) - SILsub3.count(None))
            SILsub1.append(SILsub2)
        SegmentIntlist.append(SILsub1)
    
    
    #3 BUILD NEW POLYLINES WITH NEW CONDITION
    
    polyrays = []
    for i in range (len(TgtPts)):
        Prsub1 = []
        for j in range (len(SrcPts)):
            Prsub2 = []
            for k in range (len(RList[0][0])):
                if (SegmentIntlist[i][j][k]) > (2+2*(n-1)) or (None in RList[i][j][k]) == True:
                    Prsub2.append(None)
                else:
                    Prsub2.append(rs.AddPolyline(RList[i][j][k]))
            Prsub1.append(Prsub2)
        polyrays.append(Prsub1)
    
    #################################################################################
    
    time = []
    SPL = []
    for i in range(len(TgtPts)):
        time1 = []
        SPL1 = []
        for j in range(len(SrcPts)):
            time2 = []
            SPL2 = []
            for h in range(len(RList[0][0])):
                if polyrays[i][j][h] != None:
                    time2.append((rs.CurveLength(polyrays[i][j][h]))/343)
                    SPL2.append((111-(20*math.log10(rs.CurveLength(polyrays[i][j][h])-1))-11)*(r**n))
                else:
                    time2.append(None)
                    SPL2.append(None)
            time1.append(time2)
            SPL1.append(SPL2)
        time.append(time1)
        SPL.append(SPL1)
    return (SPL,polyrays)

if Compute == True:
    FINAL = []
    for i in range (len(n)):
        FINAL.append(CodeExecution(n[i]))
    
    SPL = []
    RAYS = []
    
    for i in range (len(n)):
        SPL.append(FINAL[i][0])
        RAYS.append(FINAL[i][1])
    
    a = SPL
    b = RAYS
# ---------- end image_source ----------
export_geometry = PythonScript(Refl_Pl=join, Src_Pts=src_pts_2, Tgt_Pts=tgt_pts_2)  # -> out, a; inputs Refl_Pl: list, Src_Pts: list of Point3d, Tgt_Pts: list of Point3d
# ---------- export_geometry: Python ----------
import rhinoscriptsyntax as rs
import os


file_name = ghenv.Component.OnPingDocument().FilePath

def lvl_down(path):
    return os.path.split(path)[0]

MainFolder = lvl_down(file_name)

#convert polyline in list of points

with open(MainFolder +'\\refl_srf.txt','w') as out:
    for pl in Refl_Pl:
        s = ""
        pts_list = [rs.CurveStartPoint(line) for line in rs.ExplodeCurves(pl)]
        for i in range (len(pts_list)):
            pt = pts_list[i]
            s += str(pt.X)+','+str(pt.Y)+','+str(pt.Z)
            if i+1 < len(pts_list):
                s += '/'
        out.write(s+ '\n')


with open(MainFolder +'\\src_pts.txt','w') as out:
    for pt in Src_Pts:
        s = ""
        s += str(pt.X)+','+str(pt.Y)+','+str(pt.Z)
        out.write(s+ '\n')

with open(MainFolder +'\\tgt_pts.txt','w') as out:
    for pt in Tgt_Pts:
        s = ""
        s += str(pt.X)+','+str(pt.Y)+','+str(pt.Z)
        out.write(s+ '\n')
# ---------- end export_geometry ----------
python = PythonScript(x=image_source.b)  # -> out, a
# ---------- python: Python ----------
a = x
# ---------- end python ----------
python_2 = PythonScript(x=image_source.SrcPtsGraft)  # -> out, a; same code as python
python_3 = PythonScript(x=python.a)  # -> out, a; same code as python
panel_2 = Panel(python_2.a)
python_4 = PythonScript(x=python_3.a)  # -> out, a; same code as python
panel_3 = Panel(python_4.a)
