# Grasshopper definition geo_exporter.gh (Grasshopper 0.9.76)
# plug-ins: Python Interpreter

crv = Curve([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])
item = ListItem(List=crv, Index=0, Wrap=True)
pln = Plane(item)
crv_2 = Curve(<curve referenced from the Rhino model>)
item_2 = ListItem(List=crv, Index=0, Wrap=True)
deplane = DeconstructPlane(Plane=pln)  # -> Origin, XAxis, YAxis, ZAxis
end = EndPoints(Curve=crv_2)  # -> Start, End
explode = Explode(Curve=item_2, Recursive=True)  # -> Segments, Vertices
explode_2 = Explode(Curve=item, Recursive=True)  # -> Segments, Vertices
geo = Geometry(end.Start)
panel = Panel("-7.0593109130859375, -5.449908256530762, 12.761346817016602")
cull_i = CullIndex(List=explode.Vertices, Indices=-1, Wrap=True)
shift = ShiftList(List=cull_i, Shift=1, Wrap=True)
len = Length(Curve=item_2)
subtraction = Subtraction(A=end.End, B=end.Start)
vec2pt = Vector2Pt(PointA=cull_i, PointB=shift, Unitize=False)  # -> Vector, Length
item_3 = ListItem(List=explode_2.Vertices, Index=0, Wrap=True)
item_4 = ListItem(List=explode_2.Vertices, Index=0, Wrap=True)
geo_2 = Geometry(end.Start)
vdis = VectorDisplay(Anchor=end.Start, Vector=subtraction)
geo_3 = Geometry(end.End)
vdis_2 = VectorDisplay(Anchor=cull_i, Vector=vec2pt.Vector)
timer = Timer(TimerInterval=200, Target=python)
vlen = VectorLength(Vector=vec2pt.Vector)
subtraction_2 = Subtraction(A=geo_3, B=item_3)
subtraction_3 = Subtraction(A=geo_2, B=item_4)
ma = MassAddition(Input=vlen)  # -> Result, PartialResults
bcx = BrepCurve(Curve=crv_2)  # -> Curves, Points; disabled
python = PythonScript(x=crv)  # -> out, a; inputs x: list
# ---------- python: Python ----------
import rhinoscriptsyntax as rs
import os


file_name = ghenv.Component.OnPingDocument().FilePath

def lvl_down(path):
    return os.path.split(path)[0]

MainFolder = lvl_down(file_name)

#convert polyline in list of points

with open(MainFolder +'\\int.txt','r') as imp:
    a = imp.read()
# ---------- end python ----------
python_2 = PythonScript(x=end.End)  # -> out, a; inputs x: Point3d
# ---------- python_2: Python ----------
a =  str(x.X) + ',' + str(x.Y) + ',' +str(x.Z)
# ---------- end python_2 ----------
vdis_3 = VectorDisplay(Anchor=item_3, Vector=subtraction_2)
vdis_4 = VectorDisplay(Anchor=item_4, Vector=subtraction_3)
export_geometry = PythonScript(x=crv)  # -> out, a; inputs x: list
# ---------- export_geometry: Python ----------
import rhinoscriptsyntax as rs
import os


file_name = ghenv.Component.OnPingDocument().FilePath

def lvl_down(path):
    return os.path.split(path)[0]

MainFolder = lvl_down(file_name)

#convert polyline in list of points

with open(MainFolder +'\\refl_srf.txt','w') as out:
    for pl in x:
        s = ""
        pts_list = [rs.CurveStartPoint(line) for line in rs.ExplodeCurves(pl)]
        for i in range (len(pts_list)):
            pt = pts_list[i]
            s += str(pt.X)+','+str(pt.Y)+','+str(pt.Z)
            if i+1 < len(pts_list):
                s += '/'
        out.write(s+ '\n')
# ---------- end export_geometry ----------
python_3 = PythonScript(x=end.Start)  # -> out, a; inputs x: Point3d; same code as python_2
panel_2 = Panel(bcx.Points)
split = TextSplit(Text=panel, Separators=",")
merge = Merge(Data1=python_3.a, Data2=python_2.a)
dprod = DotProduct(VectorA=subtraction_2, VectorB=deplane.ZAxis, Unitize=False)
dprod_2 = DotProduct(VectorA=subtraction_3, VectorB=deplane.ZAxis, Unitize=False)
panel_3 = Panel(python.a)
item_5 = ListItem(List=split, Index=0, Wrap=True)  # -> Item, Item1, Item2
panel_4 = Panel(python_3.a)
panel_5 = Panel(merge)
multiplication = Multiplication(A=dprod_2, B=dprod)
python_4 = PythonScript(x=merge)  # -> out, a; inputs x: list
# ---------- python_4: Python ----------
import rhinoscriptsyntax as rs
import os


file_name = ghenv.Component.OnPingDocument().FilePath

def lvl_down(path):
    return os.path.split(path)[0]

MainFolder = lvl_down(file_name)

#convert polyline in list of points

with open(MainFolder +'\\line.txt','w') as out:
    out.write(x[0] + '\n' + x[1])
# ---------- end python_4 ----------
pt = ConstructPoint(XCoordinate=item_5.Item, YCoordinate=item_5.Item1, ZCoordinate=item_5.Item2)
panel_6 = Panel(multiplication)
item_6 = ListItem(Index=0, Wrap=True)  # -> Item, Item1
