# Grasshopper definition geo_exporter.gh (Grasshopper 0.9.76)
# plug-ins: Python Interpreter

crv = Curve([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])
crv_2 = Curve(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)
boundary = BoundarySurfaces(Edges=<geometry referenced from the Rhino model>)
timer = Timer(TimerInterval=200, Target=python_2)
end = EndPoints(Curve=crv_2)  # -> Start, End
bcx = BrepCurve(Brep=boundary, Curve=crv_2)  # -> Curves, Points; disabled
python = PythonScript(x=end.End)  # -> out, a; inputs x: Point3d
# ---------- python: Python ----------
a =  str(x.X) + ',' + str(x.Y) + ',' +str(x.Z)
# ---------- end python ----------
python_2 = PythonScript(x=crv)  # -> out, a; inputs x: list
# ---------- python_2: Python ----------
import rhinoscriptsyntax as rs
import os


file_name = ghenv.Component.OnPingDocument().FilePath

def lvl_down(path):
    return os.path.split(path)[0]

MainFolder = lvl_down(file_name)

#convert polyline in list of points

with open(MainFolder +'\\int.txt','r') as imp:
    a = imp.read()
# ---------- end python_2 ----------
export_geometry = PythonScript(x=crv)  # -> out, a; inputs x: list
# ---------- export_geometry: Python ----------
import rhinoscriptsyntax as rs
import os


file_name = ghenv.Component.OnPingDocument().FilePath

def lvl_down(path):
    return os.path.split(path)[0]

MainFolder = lvl_down(file_name)

#convert polyline in list of points

with open(MainFolder +'\\geo.txt','w') as out:
    for pl in x:
        s = ""
        pts_list = [rs.CurveStartPoint(line) for line in rs.ExplodeCurves(pl)]
        for i in range (len(pts_list)):
            pt = pts_list[i]
            s += str(pt.X)+','+str(pt.Y)+','+str(pt.Z)
            if i+1 < len(pts_list):
                s += '/'
        out.write(s+ '\n')
# ---------- end export_geometry ----------
python_3 = PythonScript(x=end.Start)  # -> out, a; inputs x: Point3d; same code as python
panel = Panel(bcx.Points)
split = TextSplit(Text=python_2.a, Separators=",")
merge = Merge(Data1=python_3.a, Data2=python.a)
python_4 = PythonScript(x=merge)  # -> out, a; inputs x: list
# ---------- python_4: Python ----------
import rhinoscriptsyntax as rs
import os


file_name = ghenv.Component.OnPingDocument().FilePath

def lvl_down(path):
    return os.path.split(path)[0]

MainFolder = lvl_down(file_name)

#convert polyline in list of points

with open(MainFolder +'\\line.txt','w') as out:
    out.write(x[0] + '\n' + x[1])
# ---------- end python_4 ----------
panel_2 = Panel(python_2.a)
item = ListItem(List=split, Index=0, Wrap=True)  # -> Item, Item1, Item2
panel_3 = Panel(python_3.a)
panel_4 = Panel(python.a)
pt = ConstructPoint(XCoordinate=item.Item, YCoordinate=item.Item1, ZCoordinate=item.Item2)
item_2 = ListItem(Index=0, Wrap=True)  # -> Item, Item1
